# Dynamo graph Breakline Replacer.dyn (Dynamo 0.9.0.3067)

getViewOfElement = Custom[GetViewOfElement]()  # Get the view in which a detail item is placed
string = StringInput("BCRA_Break Line")
byName = FamilyType.ByName(string)
all_elements_of_family_type = ElementsOfFamilyType(byName)
categories = Categories("Views")
all_elements_of_category = ElementsOfCategory(categories)
categories_2 = Categories("DetailComponents")
all_view_dependent_family = Custom[All View-Dependent Family Instances Of Category](category=categories_2, view=all_elements_of_category)  # Gets all view-dependent family instances in a given view for a given list of categories - useful for finding annotation elements
code_block = CodeBlock { 1; }
flatten = List.Flatten(list=all_view_dependent_family, amt=code_block)
containsItem = List.ContainsItem()
map = List.Map(list=flatten, f_x=containsItem)
filterByBoolMask = List.FilterByBoolMask(list=all_elements_of_category, mask=map)
firstItem = List.FirstItem(filterByBoolMask.in)
map_2 = List.Map(list=all_elements_of_family_type, f_x=firstItem)
get_view_of_element = Python(IN[0]=all_elements_of_family_type)
# ---------- get_view_of_element.python (30 lines) ----------
import System
import clr
clr.AddReference('RevitAPI')
from Autodesk.Revit.DB import *

clr.AddReference("RevitServices")
import RevitServices
from RevitServices.Persistence import DocumentManager

elements = UnwrapElement(IN[0])

doc = DocumentManager.Instance.CurrentDBDocument
collector = FilteredElementCollector(doc)
filter = ElementCategoryFilter(BuiltInCategory.OST_Views)
views = collector.WherePasses(filter)

elementOwners = list()

for element in elements:
	owner = 0
	for view in views:
		#ownerViewFilter = ElementOwnerViewFilter(view.Id)
		#ownedElements = collector.WherePasses(ownerViewFilter)
		collector = FilteredElementCollector(doc)		
		ownedElements = collector.OwnedByView(view.Id)
		if ownedElements.ToElementIds().Contains(element.Id):
			owner = view
	elementOwners.append(owner)

OUT = elementOwners
# ----------------------------------------
get_view_origins = Python(IN[0]=get_view_of_element)
# ---------- get_view_origins.python (15 lines) ----------
import clr
clr.AddReference('RevitAPI')
from Autodesk.Revit.DB import *

clr.AddReference("RevitNodes")
import Revit
clr.ImportExtensions(Revit.GeometryConversion)

views = UnwrapElement(IN[0])
output = list()

for view in views:
	output.append(view.Origin.ToPoint())

OUT = output
# ----------------------------------------
get_view_directions = Python(IN[0]=get_view_of_element)
# ---------- get_view_directions.python (15 lines) ----------
import clr
clr.AddReference('RevitAPI')
from Autodesk.Revit.DB import *

clr.AddReference("RevitNodes")
import Revit
clr.ImportExtensions(Revit.GeometryConversion)

views = UnwrapElement(IN[0])
output = list()

for view in views:
	output.append(view.ViewDirection.ToVector())

OUT = output
# ----------------------------------------
byOriginNormal = Plane.ByOriginNormal(origin=get_view_origins, normal=get_view_directions)
elementLocation = Custom[ElementLocation](element=all_elements_of_family_type)  # Returns the location of an element as an XYZ (or if it's line-based the start and end point of the line), along with some booleans to help filtering the results. Use this for some element types (e.g. walls or lines) that do not work with the built-in Get Family Instance Location node.
closestPointTo = Geometry.ClosestPointTo(geometry=byOriginNormal, other=elementLocation.points)
get_view_right_directions = Python(IN[0]=get_view_of_element)
# ---------- get_view_right_directions.python (15 lines) ----------
import clr
clr.AddReference('RevitAPI')
from Autodesk.Revit.DB import *

clr.AddReference("RevitNodes")
import Revit
clr.ImportExtensions(Revit.GeometryConversion)

views = UnwrapElement(IN[0])
output = list()

for view in views:
	output.append(view.RightDirection.ToVector())

OUT = output
# ----------------------------------------
radiansToDegrees = Math.RadiansToDegrees(elementLocation.rotation)
rotate = Vector.Rotate(get_view_right_directions, byOriginNormal, radiansToDegrees)
reverse = Vector.Reverse(rotate)
string_2 = StringInput("Left")
getParameterValueByName = Element.GetParameterValueByName(element=all_elements_of_family_type, parameterName=string_2)
translate = Geometry.Translate(geometry=closestPointTo, direction=reverse, distance=getParameterValueByName)
string_3 = StringInput("Right")
getParameterValueByName_2 = Element.GetParameterValueByName(element=all_elements_of_family_type, parameterName=string_3)
translate_2 = Geometry.Translate(geometry=closestPointTo, direction=rotate, distance=getParameterValueByName_2)
byStartPointEndPoint = Line.ByStartPointEndPoint(startPoint=translate, endPoint=translate_2)
string_4 = StringInput("b.Breakline-zigzag-open")
byName_2 = FamilyType.ByName(string_4)
byCurve = Custom[DetailComponent.ByCurve](curve=byStartPointEndPoint, familyType=byName_2, view=get_view_of_element)  # Places a line-based detail component in a given view
string_5 = StringInput("Height")
string_6 = StringInput("Masking depth")
getParameterValueByName_3 = Element.GetParameterValueByName(element=all_elements_of_family_type, parameterName=string_6)
setParameterByName = Element.SetParameterByName(element=byCurve, parameterName=string_5, value=getParameterValueByName_3)
