# Dynamo custom node ElementLocation.dyf (Dynamo 0.9.0.3067)
# category: Clockwork.Revit.Elements.Element.Query
# Returns the location of an element as an XYZ (or if it's line-based the start and end point of the line), along with some booleans to help filtering the results. Use this for some element types (e.g. walls or lines) that do not work with the built-in Get Family Instance Location node.

element = Input()
turnIntoList = Custom[Turn Into List](element)  # Turns an element (or a nested list) into a flat list
python_script = Python(IN[0]=turnIntoList)
# ---------- python_script.python (60 lines) ----------
import clr
clr.AddReference('RevitAPI')
from Autodesk.Revit.DB import *

clr.AddReference("RevitNodes")
import Revit
clr.ImportExtensions(Revit.GeometryConversion)

items = UnwrapElement(IN[0])
pointlist = list()
rotation = list()
curvepointlist = list()
ispoint = list()
iscurve = list()
curves = list()
haslocation = list()

for item in items:
	try:
		# points and text notes
		pointlist.append(item.Coord.ToPoint())
		ispoint.append(True)
		iscurve.append(False)
		haslocation.append(True)
	except:
		try:
			loc = item.Location
			if loc.ToString() == 'Autodesk.Revit.DB.LocationCurve':
				# line-based elements (e.g. walls)
				curvepoints = (loc.Curve.GetEndPoint(0).ToPoint(),loc.Curve.GetEndPoint(1).ToPoint())
				curvepointlist.append(curvepoints)
				curves.append(loc.Curve.ToProtoType())
				ispoint.append(False)
				iscurve.append(True)
				haslocation.append(True)
			elif loc.ToString() == 'Autodesk.Revit.DB.LocationPoint':
				# point-based elements
				pointlist.append(loc.Point.ToPoint())
				rotation.append(loc.Rotation)
				ispoint.append(True)
				iscurve.append(False)
				haslocation.append(True)
			else:
				ispoint.append(False)
				iscurve.append(False)
				haslocation.append(False)
		except:
			try:
				# curves
				curvepoints = (item.GetEndPoint(0).ToPoint(),item.GetEndPoint(1).ToPoint())
				curvepointlist.append(curvepoints)
				curves.append(item.ToProtoType())
				ispoint.append(False)
				iscurve.append(True)
				haslocation.append(True)
			except:
				ispoint.append(False)
				iscurve.append(False)
				haslocation.append(False)
OUT = (pointlist,rotation,curvepointlist,curves,ispoint,iscurve,haslocation)
# ----------------------------------------
code_block = CodeBlock(seq=python_script) { seq[0]; seq[1]; seq[2]; seq[3]; seq[4]; seq[5]; seq[6]; }
points = Output(code_block.out0)
curveEndpoints = Output(code_block.out2)
curves = Output(code_block.out3)
isPoint = Output(code_block.out4)
isCurve = Output(code_block.out5)
hasLocation = Output(code_block.out6)
rotation = Output(code_block.out1)
