# Dynamo custom node GetViewOfElement.dyf (Dynamo 0.9.0.3067)
# category: Revit.Elements.Element
# Get the view in which a detail item is placed

categories = Categories("Views")
all_elements_of_category = ElementsOfCategory(categories)
categories_2 = Categories("DetailComponents")
all_view_dependent_family = Custom[All View-Dependent Family Instances Of Category](category=categories_2, view=all_elements_of_category)  # Gets all view-dependent family instances in a given view for a given list of categories - useful for finding annotation elements
code_block = CodeBlock { 1; }
flatten = List.Flatten(list=all_view_dependent_family, amt=code_block)
element = Input()
containsItem = List.ContainsItem(item=element)
map = List.Map(list=flatten, f_x=containsItem)
filterByBoolMask = List.FilterByBoolMask(list=all_elements_of_category, mask=map)
firstItem = List.FirstItem(filterByBoolMask.in)
view = Output(firstItem)
