# Dynamo graph replacer.dyn (Dynamo 0.9.0.3067)

string = StringInput("BCRA_Break Line")
byName = FamilyType.ByName(string)
all_elements_of_family_type = ElementsOfFamilyType(byName)
getViewOfElement = Custom[GetViewOfElement]()  # Get the view in which a detail item is placed
map = List.Map(list=all_elements_of_family_type, f_x=getViewOfElement)
get_view_origins = Python(IN[0]=map)
# ---------- get_view_origins.python (15 lines) ----------
import clr
clr.AddReference('RevitAPI')
from Autodesk.Revit.DB import *

clr.AddReference("RevitNodes")
import Revit
clr.ImportExtensions(Revit.GeometryConversion)

views = UnwrapElement(IN[0])
output = list()

for view in views:
	output.append(view.Origin.ToPoint())

OUT = output
# ----------------------------------------
get_view_directions = Python(IN[0]=map)
# ---------- get_view_directions.python (15 lines) ----------
import clr
clr.AddReference('RevitAPI')
from Autodesk.Revit.DB import *

clr.AddReference("RevitNodes")
import Revit
clr.ImportExtensions(Revit.GeometryConversion)

views = UnwrapElement(IN[0])
output = list()

for view in views:
	output.append(view.ViewDirection.ToVector())

OUT = output
# ----------------------------------------
byOriginNormal = Plane.ByOriginNormal(origin=get_view_origins, normal=get_view_directions)
elementLocation = Custom[ElementLocation](element=all_elements_of_family_type)  # Returns the location of an element as an XYZ (or if it's line-based the start and end point of the line), along with some booleans to help filtering the results. Use this for some element types (e.g. walls or lines) that do not work with the built-in Get Family Instance Location node.
closestPointTo = Geometry.ClosestPointTo(geometry=byOriginNormal, other=elementLocation.points)
get_view_right_directions = Python(IN[0]=map)
# ---------- get_view_right_directions.python (15 lines) ----------
import clr
clr.AddReference('RevitAPI')
from Autodesk.Revit.DB import *

clr.AddReference("RevitNodes")
import Revit
clr.ImportExtensions(Revit.GeometryConversion)

views = UnwrapElement(IN[0])
output = list()

for view in views:
	output.append(view.RightDirection.ToVector())

OUT = output
# ----------------------------------------
radiansToDegrees = Math.RadiansToDegrees(elementLocation.rotation)
rotate = Vector.Rotate(get_view_right_directions, byOriginNormal, radiansToDegrees)
reverse = Vector.Reverse(rotate)
string_2 = StringInput("Left")
getParameterValueByName = Element.GetParameterValueByName(element=all_elements_of_family_type, parameterName=string_2)
translate = Geometry.Translate(geometry=closestPointTo, direction=reverse, distance=getParameterValueByName)
string_3 = StringInput("Right")
getParameterValueByName_2 = Element.GetParameterValueByName(element=all_elements_of_family_type, parameterName=string_3)
translate_2 = Geometry.Translate(geometry=closestPointTo, direction=rotate, distance=getParameterValueByName_2)
byStartPointEndPoint = Line.ByStartPointEndPoint(startPoint=translate, endPoint=translate_2)
string_4 = StringInput("b.Breakline-zigzag-open")
byName_2 = FamilyType.ByName(string_4)
byCurve = Custom[DetailComponent.ByCurve](curve=byStartPointEndPoint, familyType=byName_2, view=map)  # Places a line-based detail component in a given view
string_5 = StringInput("Height")
string_6 = StringInput("Masking depth")
getParameterValueByName_3 = Element.GetParameterValueByName(element=all_elements_of_family_type, parameterName=string_6)
setParameterByName = Element.SetParameterByName(element=byCurve, parameterName=string_5, value=getParameterValueByName_3)
get_view_orientation = Python()
# ---------- get_view_orientation.python (19 lines) ----------
import clr
clr.AddReference('RevitAPI')
from Autodesk.Revit.DB import *

clr.AddReference("RevitNodes")
import Revit
clr.ImportExtensions(Revit.GeometryConversion)

views = UnwrapElement(IN[0])
orientations = list()

for view in views:
	output = list()
	output.append(view.Origin.ToPoint())
	output.append(view.ViewDirection.ToVector())
	output.append(view.RightDirection.ToVector())
	orientations.append(output)

OUT = orientations
# ----------------------------------------
get_view_scales = Python(IN[0]=map)
# ---------- get_view_scales.python (15 lines) ----------
import clr
clr.AddReference('RevitAPI')
from Autodesk.Revit.DB import *

clr.AddReference("RevitNodes")
import Revit
clr.ImportExtensions(Revit.GeometryConversion)

views = UnwrapElement(IN[0])
output = list()

for view in views:
	output.append(view.Scale)

OUT = output
# ----------------------------------------
