# Dynamo graph test.dyn (Dynamo 0.9.0.3067)

views = Views("Section 1")
plane = Custom[View.Plane](view=views)  # Retrieves the plane of a given view
origin = Plane.Origin(plane)
create = List.Create(views)
rightDirection = Python(IN[0]=create)
# ---------- rightDirection.python (17 lines) ----------
import clr
clr.AddReference('RevitAPI')
from Autodesk.Revit.DB import *

clr.AddReference("RevitNodes")
import Revit
clr.ImportExtensions(Revit.GeometryConversion)

items = UnwrapElement(IN[0])
resultlist = list()

for item in items:
	try:
		resultlist.append(item.RightDirection.ToVector())
	except:
		resultlist.append(list())
OUT = resultlist
# ----------------------------------------
number = DoubleInput(3)
translate = Geometry.Translate(geometry=origin, direction=rightDirection, distance=number)
normal = Plane.Normal(plane)
number_2 = DoubleInput(180)
rotate = Vector.Rotate(rightDirection, normal, number_2)
translate_2 = Geometry.Translate(geometry=origin, direction=rotate, distance=number)
byStartPointEndPoint = Line.ByStartPointEndPoint(startPoint=translate, endPoint=translate_2)
string = StringInput("b.Breakline-zigzag-open")
byName = FamilyType.ByName(string)
byCurve = Custom[DetailComponent.ByCurve](curve=byStartPointEndPoint, familyType=byName, view=views)  # Places a line-based detail component in a given view
python_script = Python(IN[0]=create)
# ---------- python_script.python (20 lines) ----------
import clr
clr.AddReference('RevitAPI')
from Autodesk.Revit.DB import *

clr.AddReference("RevitNodes")
import Revit
clr.ImportExtensions(Revit.GeometryConversion)

items = UnwrapElement(IN[0])
elementlist = list()
olist = list()
dlist = list()

for item in items:
	try:
		olist.append(item.Origin.ToPoint())
		dlist.append(item.ViewDirection.ToVector())
	except:
		elementlist.append(list())
OUT = (olist,dlist)
# ----------------------------------------
